# Grasshopper definition test_main_2.gh (Grasshopper 1.0.8)

panel = Panel("0.000,0.000,0.000;73.288,9.326,0.000;85.434,-87.038,0.000;32.338,-126.464,0.000;0.000,0.000,0.000")
envelope_vertices = GetString(panel, AtLeast=1, AtMost=1, TreeAccess=False)
envelope_subdivideu = GetString(Slider(2, range=1..4), AtLeast=1, AtMost=1, TreeAccess=False)
envelope_subdividev = GetString(Slider(2, range=1..4), AtLeast=1, AtMost=1, TreeAccess=False)
envelope_setback = GetString(Slider(6, range=2..10), AtLeast=1, AtMost=1, TreeAccess=False)
buldings_setback = GetString(Slider(5, range=5..10), AtLeast=1, AtMost=1, TreeAccess=False)
no_of_floors = GetNumber(Slider(8, range=0..10), AtLeast=1, AtMost=1, Maximum=1.797693135e+308, Minimum=-1.797693135e+308, TreeAccess=False)
floor_height = GetNumber(Slider(4, range=0..10), AtLeast=1, AtMost=1, Maximum=1.797693135e+308, Minimum=-1.797693135e+308, TreeAccess=False)
tmatch = MatchText(Text=envelope_vertices, Pattern="0", Case=True)
gate = StreamGate(Stream=envelope_vertices, Gate=tmatch)  # -> Target0, Target1
series = Series(Start=floor_height, Step=floor_height, Count=no_of_floors)
multiplication = Multiplication(A=floor_height, B=no_of_floors)
split = TextSplit(Text=gate.Target0, Separators=";")
Z = UnitZ(Factor=series)
pline = PolyLine(Vertices=split, Closed=True)
offset = OffsetCurve(Curve=pline, Distance=expr("-x", envelope_setback), Corners=1)
mesh = Mesh(pline)

srf = Surface(reparameterize(offset))
divide = DivideDomain²(Domain=srf, UCount=envelope_subdivideu, VCount=envelope_subdividev)
subsrf = Isotrim(Surface=reparameterize(srf), Domain=divide)

mcol = MeshColours(Mesh=mesh, Colours=ColourSwatch(SwatchColor=RGB(167, 232, 70)))
offset_2 = OffsetCurve(Curve=subsrf, Distance=expr("-x", buldings_setback), Corners=1)
lng = ListLength(List=flatten(offset_2))
series_2 = Series(Start=0, Step=1, Count=lng)
Z_2 = UnitZ(Factor=multiplication)
split_2 = TextSplit(Text="#fde2e2,#e8eaf6,#ede7f6,#e3f2fd,#fbe9e7,#e0f7fa,#f1f8e9", Separators=",")
extr = Extrude(Base=offset_2, Direction=Z_2)
item = ListItem(List=split_2, Index=series_2, Wrap=True)
cap = CapHoles(Brep=extr)
mcol_2 = MeshColours(Mesh=cap, Colours=graft(item))
move = Move(Geometry=mcol_2, Motion=Z)  # -> Geometry, Transform
mjoin = MeshJoin(Meshes=flatten([mcol_2, mcol]))

# ---- group: RH_OUT:meshout
mesh_2 = Mesh(mjoin)
